# Grasshopper definition 지연_2-1_숙제.gh (Grasshopper 1.0.7)

# ---- group: 문제1
geo = Geometry(Tree({0;0;0}: [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], {0;0;1}: [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], {0;0;2}: [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], {0;0;3}: [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], {0;0;4}: [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], {0;0;5}: [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], {0;0;6}: [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], {0;0;7}: [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], {0;0;8}: [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], {0;0;9}: [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]))
flip = FlipMatrix(Data=geo)
flatten = FlattenTree(Tree=geo, Path="{0}")
flatten_2 = FlattenTree(Tree=flip, Path="{0}")
image = ImageSampler(
    FilePath="D:\temporary\알바\고고\모듈 2-1\숙제\답1.jpg",
    Filter="Colour",
    Interpolate=True,
    Umax=3508,
    Umin=1,
    Vmax=2480,
    Vmin=1,
    Wrap=1)
image_2 = ImageSampler(
    FilePath="D:\temporary\알바\고고\모듈 2-1\숙제\답2.jpg",
    Filter="Colour",
    Interpolate=True,
    Umax=3508,
    Umin=1,
    Vmax=2480,
    Vmin=1,
    Wrap=1)

# ---- group: 문제1 / 숙제 부분
Z = UnitZ(Factor="5")
lng = ListLength(List=flatten)
move = Move(Geometry=flatten, Motion=Z)  # -> Geometry, Transform
division = Division(A="90", B=lng)
division_2 = Division(A="1", B=lng)
area = Area(Geometry=move.Geometry)  # -> Area, Centroid
series = Series(Start=division_2, Step=division_2, Count=lng)
series_2 = Series(Start=division, Step=division, Count=lng)
scale = Scale(Geometry=move.Geometry, Center=area.Centroid, Factor=series)  # -> Geometry, Transform
unflatten = UnflattenTree(Tree=scale.Geometry, Guide=geo)
flip_2 = FlipMatrix(Data=unflatten)
flatten_3 = FlattenTree(Tree=flip_2, Path="{0}")
item = ListItem(List=flatten_3, Index=Slider(60, range=0..80), Wrap=True)
area_2 = Area(Geometry=flatten_3)  # -> Area, Centroid
rotate = Rotate(Geometry=flatten_3, Angle=degrees(series_2), Plane=area_2.Centroid)  # -> Geometry, Transform

lng_2 = ListLength(List=geo)
Z_2 = UnitZ(Factor="5")
flatten_4 = FlattenTree(Tree=lng_2, Path="{0}")
move_2 = Move(Geometry=geo, Motion=Z_2)  # -> Geometry, Transform
item_2 = ListItem(List=flatten_4, Index=0, Wrap=True)
area_3 = Area(Geometry=move_2.Geometry)  # -> Area, Centroid
division_3 = Division(A="90", B=item_2)
division_4 = Division(A="1", B=item_2)
series_3 = Series(Start=division_4, Step=division_4, Count=item_2)
series_4 = Series(Start=division_3, Step=division_3, Count=item_2)
scale_2 = Scale(Geometry=move_2.Geometry, Center=area_3.Centroid, Factor=series_3)  # -> Geometry, Transform
rotate_2 = Rotate(Geometry=scale_2.Geometry, Angle=degrees(series_4), Plane=area_3.Centroid)  # -> Geometry, Transform

# ---- group: 문제1
merge = Merge(Data1=simplify(graft(geo)), Data2=simplify(graft(rotate_2.Geometry)))
loft = Loft(Curves=merge, Options={Adjust=False, Closed=False, LoftEnds=0, LoftSimp=0, LoftType=0, Rebuild=10, Refit=0.01})
cap = CapHoles(Brep=loft)
preview = CustomPreview(Geometry=cap, Material=ColourSwatch(SwatchColor=RGB(201, 109, 109)))

merge_2 = Merge(Data1=simplify(graft(flatten_2)), Data2=simplify(graft(rotate.Geometry)))
loft_2 = Loft(Curves=merge_2, Options={Adjust=False, Closed=False, LoftEnds=0, LoftSimp=0, LoftType=0, Rebuild=10, Refit=0.01})
cap_2 = CapHoles(Brep=loft_2)
preview_2 = CustomPreview(Geometry=cap_2, Material=ColourSwatch(SwatchColor=RGB(201, 109, 109)))
